# Grasshopper definition UR5_Print.ghx (Grasshopper 1.0.7)

velocities = Slider(23, range=0..100)
tcp_z = Slider(139, range=0..1000)

fabrication = GhPythonScript(velosities=velocities, myTCP_z=tcp_z, send=Toggle(False))  # -> out, rhino_base_way_planes, robot_planes, script; inputs points: list, blend_radiuses: list, extruder_toggles: list, velosities: list
# ---------- fabrication: Python ----------
from compas_rhino import unload_modules
unload_modules('simple_ur_script')
unload_modules('simple_comm')

import Rhino.Geometry as rg
import simple_comm as c
import simple_ur_script as ur

import math as m


def tcp(script):
    """ This funktion sets tcp 
    """
    script += ur.set_tcp_by_angles(
        float(0.0), float(0.0), float(myTCP_z), m.radians(0.0), m.radians(180.0), m.radians(90))
    return script

def set_robot_base_plane_from_pts():

    pt_0 = rg.Point3d(350, 230, 0)  # base plane origin
    # point on base plane positive x direction
    pt_1 = rg.Point3d(499, 230, 0)
    pt_2 = rg.Point3d(499, 499, 0)  # point on base plane positive xy

    robot_base = rg.Plane(pt_0, pt_1-pt_0, pt_2-pt_0)
    return robot_base

def rhino_to_robot_space(rhino_plane):
    """ this funktion translates planes from the rhino cordinate system to
    the robot cordinate system 
    """
    robot_plane = rhino_plane.Clone()
    _r_matrix = rg.Transform.PlaneToPlane(
        rg.Plane.WorldXY, set_robot_base_plane_from_pts())
    
    robot_plane.Transform(_r_matrix)
    return robot_plane
    

def point_to_rhino_plane(point):
    rhino_plane = rg.Plane(point, rg.Vector3d.XAxis, rg.Vector3d.YAxis)
    return rhino_plane

def extrude(plane, vel, blend_radi, extr, script):
    newval = 0
    vel = vel/1000
    blend_radi = blend_radi/1000
    script += ur.move_l_blend(plane, vel, blend_radi)
    
    if extr ==1:
        extr = False
        newval = True
    else:
        extr = True
        newval = False
    script += ur.set_digital_out(5, extr)
    script += ur.set_digital_out(6,newval)
    #script += ur.set_digital_out(7,newval)
    
    
    return script 


""" Robotic fabrication procedure
"""
script = ""

script = tcp(script)


"""Create rhino planes
"""

rhino_base_way_planes = []
for point in points:
    rhino_base_way_planes.append(point_to_rhino_plane(point))

"""Translate rhino planes to robot_plabe 
"""

robot_planes = []

for rhino_plane in (rhino_base_way_planes):
    robot_planes.append(rhino_to_robot_space(rhino_plane))
#    print rhino_plane.Origin
    
"""Create comands
"""

cnt = 0
for plane, velocity, blend_radi, extruder_toggle in zip(robot_planes, velosities,blend_radiuses, extruder_toggles):
    cnt += 1
    if cnt < 20000:
       script = extrude(plane, velocity, blend_radi, extruder_toggle, script)

if send:
    script = c.concatenate_script(script)
    #print script
    c.send_script(script, "192.168.10.10")
# ---------- end fabrication ----------
write_to_file = GhPythonScript(script=fabrication.script)  # -> out
# ---------- write_to_file: Python ----------
f = open("Z:/Desktop/20201207_fabrication.txt", "w")   # 'r' for reading and 'w' for writing
f.write(script)  
f.close()                                # Close file 


f = open("Z:/Desktop/20201207_fabrication.txt", "r")   # 'r' for reading and 'w' for writing
print f.read()                           # Write inside file 
f.close()                                # Close file
# ---------- end write_to_file ----------
geometry = Geometry(fabrication.robot_planes)
