# Grasshopper definition Geometries.ghx (Grasshopper 1.0.7)
# plug-ins: LunchBox

rectangle = Rectangle(Plane=PlaneXY(0, 0, 0), XSize=Slider(500, range=0..1000), YSize=Slider(800, range=0..1000), Radius=0)  # -> Rectangle, Length
offset = OffsetCurve(Curve=rectangle.Rectangle, Distance=1, Plane=PlaneXY(0, 0, 0), Corners=1)
diamond = DiamondPanels(Surface=rectangle.Rectangle, UDivisions=Slider(9, range=0..10), VDivisions=Slider(7, range=0..10))  # -> DiamondPanels, TriPanels

number_slider = Slider(200, range=0..1000)
number_slider_2 = Slider(175, range=0..1000)

number_slider_3 = Slider(200, range=0..1000)
wip_geo = GhPythonScript(x=number_slider_3, y=number_slider_3)  # -> out, a
# ---------- wip_geo: Python ----------
import rhinoscriptsyntax as rs
import Rhino.Geometry as rg 
import ghpythonlib.components as gh

#define base rectangle 


origin = rg.Plane( rg.Point3d(0,0,0), rg.Vector3d.ZAxis)
rectangle = rg.Rectangle3d(origin, 200, 200)

edges = gh.Explode(rectangle, True)[0]

s_edges = gh.ListItem(edges,[1,3], False)

divided_edges = gh.DivideCurve(s_edges, 10, True)[0]

L = int(gh.ListLength(divided_edges)/2)

print (L)


split_list1 = gh.SplitList(divided_edges, L)[0]
split_list2 = gh.ReverseList(gh.SplitList(divided_edges, L)[1])

new_lines = gh.Line(split_list1,split_list2)  

new_points = gh.DivideCurve(new_lines, 10, True)[0]

mp1 = gh.Move((gh.Dispatch(new_points, [True, False])[0]), rg.Vector3d(0,20,0))[0]
mp2 = gh.Move((gh.Dispatch(new_points, [True, False])[1]), rg.Vector3d(0,20,0))[0]

##a = gh.Weave(mp1,mp2)

#a = gh.PolyLine(pts, False)

list0= mp1
list1= mp2

zipped=zip(list0,list1)
result0=[item for sublist in zipped for item in sublist]

result1=[]
for sublist in zipped:
    for item in sublist:
        result1.append(item)
print result0
print result1
# ---------- end wip_geo ----------
geo = Geometry(wip_geo.a)

number_slider_4 = Slider(600, range=0..1000)
number_slider_5 = Slider(2, range=0..10)
rectangle_2 = Rectangle(Plane=PlaneXY(0, 0, 0), XSize=number_slider_4, YSize=number_slider_4, Radius=0)  # -> Rectangle, Length
number_slider_6 = Slider(2, range=0..10)
diamond_2 = DiamondPanels(Surface=rectangle_2.Rectangle, UDivisions=Slider(1, range=0..10), VDivisions=Slider(0, range=0..10))  # -> DiamondPanels, TriPanels
neg = Negative(Value=number_slider_5)
fillet = Fillet(Curve=diamond_2.DiamondPanels, Radius=number_slider_6)
fillet_2 = Fillet(Curve=diamond_2.TriPanels, Radius=number_slider_6)
merge = Merge(Data1=fillet, Data2=fillet_2)
offset_2 = OffsetCurve(Curve=merge, Distance=neg, Plane=PlaneXY(0, 0, 0), Corners=1)

x_row = Slider(9, range=0..10)
y_row = Slider(4, range=0..10)
print_bed_ur5 = Geometry(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)
cluster = Cluster_2(A=Slider(0.5, range=0..1), relay=y_row, relay_2=x_row, X=Slider(200, range=0..1000), Y=Slider(200, range=0..1000))  # -> pl, R
panel = Panel(cluster.R)

number_slider_7 = Slider(3, range=0..10)
number_slider_8 = Slider(3, range=0..10)
rectangle_3 = Rectangle(Plane=PlaneXY(0, 0, 0), XSize=number_slider_2, YSize=Slider(700, range=0..1000), Radius=0)  # -> Rectangle, Length
number_slider_9 = Slider(1, range=0..1)
squads = SkewedQuads(Surface=rectangle_3.Rectangle, UDivisions=Slider(1, range=0..10), VDivisions=Slider(3, range=0..10), TParameter=0)  # -> FullPanels, EdgePanels
number_slider_10 = Slider(3, range=0..10)
quads = QuadPanels(Surface=rectangle_2.Rectangle, UDivisions=number_slider_8, VDivisions=number_slider_8)
X = UnitX(Factor=expr("x*2", number_slider_2))
merge_2 = Merge(Data1=squads.FullPanels, Data2=squads.EdgePanels)
tria = TriangularPanelsA(Surface=rectangle_2.Rectangle, UDivisions=Slider(2, range=0..10), VDivisions=Slider(3, range=0..10))
tric = TrianglePanelsC(Surface=rectangle_2.Rectangle, UDivisions=number_slider_10, VDivisions=number_slider_10)
series = Series(Start=0, Step=1, Count=10)
mirror = Mirror(Geometry=merge_2, Plane=PlaneYZ(0, 0, 0))  # -> Geometry, Transform
offset_3 = OffsetCurve(Curve=rectangle_2.Rectangle, Distance=number_slider_5, Plane=PlaneXY(0, 0, 0), Corners=1)
panel_2 = Panel("""2.2
4.4""")
merge_3 = Merge(Data1=merge_2, Data2=mirror.Geometry)
offset_4 = OffsetCurve(Curve=tric, Distance=neg, Plane=PlaneXY(0, 0, 0), Corners=1)
merge_4 = Merge(Data1=offset_2, Data2=offset_3)  # -> flatten(Result)
offset_5 = OffsetCurve(Curve=rectangle_2.Rectangle, Distance=panel_2, Plane=PlaneXY(0, 0, 0), Corners=1)
fillet_3 = Fillet(Curve=offset_4, Radius=Slider(3, range=0..10))
panel_3 = Panel("""3
3
3
3
-3
-3
-3
-3""")
offset_6 = OffsetCurve(Curve=merge_3, Distance=expr("-x", panel_3), Plane=PlaneXY(0, 0, 0), Corners=1)
arrlinear = LinearArray(Geometry=offset_6, Direction=X, Count=Slider(2, range=0..10))  # -> flatten(Geometry), Transform
area = Area(Geometry=arrlinear.Geometry)  # -> Area, Centroid
pdecon = Deconstruct(Point=area.Centroid)  # -> XComponent, YComponent, ZComponent
sort = SortList(Keys=pdecon.XComponent, ValuesA=arrlinear.Geometry)  # -> Keys, ValuesA
merge_5 = Merge(Data1=flatten(offset_5), Data2=flatten(fillet_3))  # -> flatten(Result)
geo_2 = Geometry(sort.ValuesA)
bbox = BoundingBox(Content=geo_2, Plane=PlaneXY(0, 0, 0), UnionBox=True)  # -> Box, Box_2
debrep = DeconstructBrep(Brep=bbox.Box)  # -> Faces, Edges, Vertices
geo_3 = Geometry(merge_5)
item = ListItem(List=debrep.Faces, Index=0, Wrap=True)
debrep_2 = DeconstructBrep(Brep=item)  # -> Faces, Edges, Vertices
join = JoinCurves(Curves=debrep_2.Edges, Preserve=False)
offset_7 = OffsetCurve(Curve=join, Distance=Slider(6, range=0..10), Plane=PlaneXY(0, 0, 0), Corners=1)

horizontal_count = Slider(1, range=0..10)
list = ValueList({"One": 1, "Two": 2, "Three": 2² - 1, "Four": Sqrt(16)}, selected="One")
data = Data(geo_2)
crv = Curve(data)

horizontal_count_2 = Slider(1, range=0..10)
list_2 = ValueList({"One": 1, "Two": 2, "Three": 2² - 1, "Four": Sqrt(16)}, selected="One")
data_2 = Data({Plane=PlaneXY(560.1772031, 178.3406517, -1070.221751), Size=Domain2(u=0..200, v=0..200)})
crv_2 = Curve(data_2)

layer_height = Slider(2, range=0..10)
line_space = Slider(1.5, range=0..10)

layer_height_2 = Slider(2, range=0..10)
layer_number = Slider(1, range=0..10)

parameters_for_mesh = ParametersForMesh(
    data=line_space,
    data_2=layer_height,
    crv=crv_2,
    C_2=horizontal_count_2,
    A_2=list_2,
    crv_3=crv,
    C=horizontal_count,
    A=list)  # -> M_2, M
mesh = Mesh(parameters_for_mesh.M_2)
mesh_2 = Mesh(parameters_for_mesh.M)
merge_6 = Merge(Data1=mesh, Data2=mesh_2)  # -> flatten(Result)
geo_4 = Geometry(merge_6)
mjoin = MeshJoin(Meshes=geo_4)
export_obj = GhPythonScript(export=Button(), mesh=mjoin, ObjName="20210712_arrow_2.obj")  # -> out, a; inputs mesh: Mesh
# ---------- export_obj: Python ----------
import os
import sys
import compas_rhino
from compas_rhino.geometry import RhinoMesh
import Rhino.Geometry as rg 


filepath = ghenv.Component.Attributes.Owner.OnPingDocument().FilePath

#path is the main stream save .obj in the "data" folder for slicing

path = os.path.abspath(os.path.join(filepath, "..","data","3D_for_4D.obj"))

#path_storage is the main second saver to .obj in the "obj" folder for documentation
#change ObjName in the panel to not overwrite your archives .obj

path_storage = os.path.abspath(os.path.join(filepath, "..", "..","obj",ObjName))


print (path_storage)
HERE = os.path.join(os.path.abspath(path)) 
HERE_storage = os.path.join(os.path.abspath(path_storage))

#######


if export:
    print(HERE)
    c_mesh = RhinoMesh.from_geometry(mesh).to_compas()
    c_mesh.to_obj(HERE, None, True)
    c_mesh.to_obj(HERE_storage, None, True)
# ---------- end export_obj ----------

cluster_2 = Cluster(A=layer_height_2, B=layer_number)

# ----
# Export obj. to data
panel_4 = Panel("20210722_diamond_large_in.obj")
mjoin_2 = MeshJoin(Meshes=cluster_2)
export_obj_2 = GhPythonScript(export=Button(), mesh=mjoin_2, ObjName=panel_4)  # -> out, a; inputs mesh: Mesh
# ---------- export_obj_2: Python ----------
import os
import sys
import compas_rhino
from compas_rhino.geometry import RhinoMesh
import Rhino.Geometry as rg 


filepath = ghenv.Component.Attributes.Owner.OnPingDocument().FilePath
path = os.path.abspath(os.path.join(filepath, "..","data","3D_for_4D.obj"))
path_storage = os.path.abspath(os.path.join(filepath, "..", "..","obj",ObjName))

print (path_storage)
HERE = os.path.join(os.path.abspath(path)) 
HERE_storage = os.path.join(os.path.abspath(path_storage))

#######


if export:
    print(HERE)
    print(HERE_storage)
    c_mesh = RhinoMesh.from_geometry(mesh).to_compas()
    c_mesh.to_obj(HERE, None, True)
    c_mesh.to_obj(HERE_storage, None, True)
# ---------- end export_obj_2 ----------

# ==== cluster Cluster
A = ClusterInput()
B = ClusterInput()
multiplication = Multiplication(A=A, B=B)
B_2 = ClusterInput()
Z = UnitZ(Factor=expr("x-0.05", multiplication))
extr = Extrude(Base=B_2, Direction=Z)
rebsrf = RebuildSurface(Surface=extr, CountU=Slider(3, range=0..10), CountV=Slider(300, range=0..1000))
mjoin = MeshJoin(Meshes=rebsrf)
tri = Triangulate(Mesh=mjoin)  # -> Mesh, Count
M = ClusterOutput(tri.Mesh)

# ==== cluster ParametersForMesh
C = ClusterInput()
C_2 = ClusterInput()
data = ClusterInput()
data_2 = ClusterInput()
data_3 = Data(data)
data_4 = Data(data_2)
A = ClusterInput()
A_2 = ClusterInput()
crv = ClusterInput()

# ---- group: Edge Curves
multiplication = Multiplication(A=data_3, B=Slider(2, range=0..10))
multiplication_2 = Multiplication(A=A_2, B=data_4)
series = Series(Start=data_3, Step=multiplication, Count=C_2)
subtraction = Subtraction(A=multiplication_2, B=Slider(0.05, range=0..0.1))
crv_2 = Curve(crv)
Z = UnitZ(Factor=subtraction)
extr = Extrude(Base=crv_2, Direction=Z)
mesh = MeshBrep(
    Brep=extr,
    Settings={GridMaxCount=0, GridMinCount=16, JaggedSeams=False, MaxEdgeLength=0, MinEdgeLength=0.0001, MinTolerance=0, Refine=True, RefineAngle=0, RelativeTolerance=0.65, SimplePlanes=True, Tolerance=0})
tri = Triangulate(Mesh=mesh)  # -> Mesh, Count

# ----
crv_3 = ClusterInput()

# ---- group: Filler_Curves
multiplication_3 = Multiplication(A=data_3, B=Slider(2, range=0..10))
multiplication_4 = Multiplication(A=A, B=data_4)
series_2 = Series(Start=data_3, Step=multiplication_3, Count=C)
subtraction_2 = Subtraction(A=multiplication_4, B=Slider(0.05, range=0..0.1))
neg = Negative(Value=series_2)
crv_4 = Curve(crv_3)
Z_2 = UnitZ(Factor=subtraction_2)
extr_2 = Extrude(Base=crv_4, Direction=Z_2)
mesh_2 = MeshBrep(
    Brep=extr_2,
    Settings={GridMaxCount=0, GridMinCount=16, JaggedSeams=False, MaxEdgeLength=0, MinEdgeLength=0.0001, MinTolerance=0, Refine=True, RefineAngle=0, RelativeTolerance=0.65, SimplePlanes=True, Tolerance=0})
tri_2 = Triangulate(Mesh=mesh_2)  # -> Mesh, Count

# ----
M = ClusterOutput(tri_2.Mesh)
M_2 = ClusterOutput(tri.Mesh)

# ==== cluster Cluster_2
X = ClusterInput()
Y = ClusterInput()
relay = ClusterInput()
rectangle = Rectangle(Plane=PlaneXY(0, 0, 0), XSize=X, YSize=Y, Radius=0)  # -> Rectangle, Length
relay_2 = ClusterInput()
explode = Explode(Curve=rectangle.Rectangle, Recursive=True)  # -> Segments, Vertices
item = ListItem(List=explode.Segments, Index=0, Wrap=True)  # -> Item, Item1, Item2, Item3
divide = DivideCurve(Curve=item.Item3, Count=relay, Kinks=False)  # -> reverse(Points), Tangents, Parameters
divide_2 = DivideCurve(Curve=item.Item1, Count=relay, Kinks=False)  # -> Points, Tangents, Parameters
ln = Line(StartPoint=divide_2.Points, EndPoint=divide.Points)
item_2 = ListItem(List=divide_2.Points, Index=0, Wrap=True)  # -> Item, Item1
A = ClusterInput()
dispatch = Dispatch(List=ln, DispatchPattern=[True, False])  # -> ListA, ListB
dist = Distance(PointA=item_2.Item, PointB=item_2.Item1)  # -> expr("x/2", Distance)
divide_3 = DivideCurve(Curve=dispatch.ListA, Count=relay_2, Kinks=False)  # -> Points, Tangents, Parameters
divide_4 = DivideCurve(Curve=dispatch.ListB, Count=relay_2, Kinks=False)  # -> Points, Tangents, Parameters
addition = Addition(A=A, B=dist)
dispatch_2 = Dispatch(List=divide_3.Points, DispatchPattern=[True, False])  # -> ListA, ListB
dispatch_3 = Dispatch(List=divide_4.Points, DispatchPattern=[True, False])  # -> ListA, ListB
Y_2 = UnitY(Factor=addition)
rev = Reverse(Vector=Y_2)
rev_2 = Reverse(Vector=Y_2)
move = Move(Geometry=dispatch_2.ListA, Motion=Y_2)  # -> Geometry, Transform
move_2 = Move(Geometry=dispatch_2.ListB, Motion=rev)  # -> Geometry, Transform
move_3 = Move(Geometry=dispatch_3.ListA, Motion=rev_2)  # -> Geometry, Transform
move_4 = Move(Geometry=dispatch_3.ListB, Motion=Y_2)  # -> Geometry, Transform
weave = Weave(Pattern=[0, 1], Stream0=move.Geometry, Stream1=move_2.Geometry, NullGaps=False)
weave_2 = Weave(Pattern=[0, 1], Stream0=move_3.Geometry, Stream1=move_4.Geometry, NullGaps=False)
pline = PolyLine(Vertices=weave, Closed=False)
pline_2 = PolyLine(Vertices=weave_2, Closed=False)
divide_5 = DivideCurve(Curve=pline_2, Count=10, Kinks=False)  # -> reverse(Points), Tangents, Parameters
divide_6 = DivideCurve(Curve=pline, Count=10, Kinks=False)  # -> Points, Tangents, Parameters
cp = ControlPoints(Curve=pline)  # -> Points, Weights, Knots
cp_2 = ControlPoints(Curve=pline_2)  # -> reverse(Points), Weights, Knots
intcrv = Interpolate(Vertices=divide_6.Points, Degree=3, Periodic=False, KnotStyle=1)  # -> Curve, Length, Domain
intcrv_2 = Interpolate(Vertices=divide_5.Points, Degree=3, Periodic=False, KnotStyle=1)  # -> Curve, Length, Domain
merge = Merge(Data1=cp.Points, Data2=cp_2.Points)  # -> flatten(Result)
Z = UnitZ(Factor=Slider(1, range=0..1))
move_5 = Move(Geometry=merge, Motion=Z)  # -> reverse(Geometry), Transform
number_slider = Slider(13, range=0..100)
merge_2 = Merge(Data1=merge, Data2=move_5.Geometry)
number_slider_2 = Slider(13, range=0..100)
pline_3 = PolyLine(Vertices=merge_2, Closed=False)
len = Length(Curve=pline_3)
pl = ClusterOutput(pline_3)
expression = Expression(x=len, y=number_slider_2, Expression="(x/y)/60")
concat = Concatenate(FragmentA=number_slider_2, FragmentB=" mm/s")
concat_2 = Concatenate(FragmentA=expression, FragmentB=" min")
merge_3 = Merge(Data1=concat_2, Data2=concat)
R = ClusterOutput(merge_3)
